# Grasshopper definition SolidSlicer.gh (Grasshopper 1.0.7)
# plug-ins: Pufferfish, LunchBox, Wombat

# ---- group: Set Solid and Floor
# Script by JakkeLab
# Date : 23.01.09
# https://github.com/JakkeLab
floor_info = FilePath("C:\Users\Jake\OneDrive\JAKK3 Lab\Drone\현장별 기술지원\01_토공량\2219_을지로12BL\03_결과물\층 프로파일\층 프로파일.csv")
solids = Brep([<brep referenced from the Rhino model> x3])

# ----
file = ReadFile(File=floor_info, PerLineParse=True)
csv = ReadCSV(CSVString=file, Delimiter=",")  # -> Headers, Values
flip = FlipMatrix(Data=csv.Values)
lng = ListLength(List=flip)
python = GhPythonScript(x=csv.Headers)  # -> a; inputs x: list
# ---------- python: Python ----------
__author__ = "Jake"
__version__ = "2023.01.09"

import rhinoscriptsyntax as rs

a = x.index("레벨")
# ---------- end python ----------
subtraction = Subtraction(A=lng, B=1)
item = ListItem(List=flip, Index="1", Wrap=True)  # -> flatten(Item)
item_2 = ListItem(List=flip, Index=subtraction, Wrap=True)  # -> flatten(Item)
item_3 = ListItem(List=flip, Index=python, Wrap=True)  # -> flatten(Item)
clean = CleanTree(RemoveNulls=True, RemoveInvalid=True, RemoveEmpty=True, Tree=item_2)
item_4 = ListItem(List=clean, Index=0, Wrap=True)
doc_units = DocumentUnits()
expression = Expression(U=doc_units, Expression="IF(U = \"Meters\", 1000, 1)")
expression_2 = Expression(U=item_4, Expression="IF(U = \"Meters\", 1000, 1)")
brec = BoundingRectangle(Geometry=solids, Plane=PlaneXY(0, 0, 0), Axis=0, Slide=0, Union=True)  # -> Bounding, DimensionX, DimensionY
crv = Curve(brec.Bounding)
division = Division(A=expression, B=expression_2)
explode = Explode(Curve=crv, Recursive=True)  # -> Segments, Vertices
pdecon = Deconstruct(Point=explode.Vertices)  # -> XComponent, YComponent, ZComponent
graft = GraftTree(Tree=item_3, IncludeEmptyLists=True, IncludeNullItems=True)
division_2 = Division(A=graft, B=division)
pt = ConstructPoint(XCoordinate=pdecon.XComponent, YCoordinate=pdecon.YComponent, ZCoordinate=division_2)
item_5 = ListItem(List=pt, Index=0, Wrap=True)
item_6 = ListItem(List=pt, Index=1, Wrap=True)
item_7 = ListItem(List=pt, Index=2, Wrap=True)
item_8 = ListItem(List=pt, Index=3, Wrap=True)
srf4pt = _4PointSurface(CornerA=item_5, CornerB=item_6, CornerC=item_7, CornerD=item_8)  # -> flatten(Surface)

# ---- group: Study
# 230109
# 230110
c_study = CSharpScript()  # -> A; inputs B: list of Guid, C: list of Surface
# ---------- c_study: C# ----------
    List<Brep> breps = new List<Brep>();
    List<BoundingBox> boundings = new List<BoundingBox>();
    List<Plane> convertedPlanes = new List<Plane>();
    List<Plane> sortedPlane = new List<Plane>();
    List<double> rawOriginZ = new List<double>();
    List<double> sortedOriginZ = new List<double>();
    List<int> test = new List<int>();
    
    //Srf to Plane
    foreach(var item in C)
    {
      Point3d pOrigin = item.PointAt(0, 0);
      Vector3d pNormal = item.NormalAt(0, 0);
      Plane pPlane = new Plane(pOrigin, pNormal);
      convertedPlanes.Add(pPlane);
    }
    
    //Guid to Brep
    for(int i = 0; i < B.Count; i++)
    {
      var RhinoObject = RhinoDocument.Objects.Find(B[i]);
      var Geometry = RhinoObject.Geometry;
      Brep aBrep = Brep.TryConvertBrep(Geometry);                   //Brep으로 바꿔줘야 한다
      breps.Add(aBrep);
    }
# ---------- end c_study ----------
c_script = CSharpScript()  # -> A, Cutters; inputs B: list of Guid, C: list of Surface
# ---------- c_script: C# ----------
    List<Brep> breps = new List<Brep>();
    List<Brep> cutterBreps = new List<Brep>();
    List<Surface> sortedSrfs = new List<Surface>();
    List <double> unsortedOriginZ = new List<double>();
    List <double> sortedOriginZ = new List<double>();
    List<BoundingBox> boundings = new List<BoundingBox>();
    List<Brep> diffed = new List<Brep>();
    //Guid to Brep
    for(int i = 0; i < B.Count; i++)
    {
      var RhinoObject = RhinoDocument.Objects.Find(B[i]);
      var Geometry = RhinoObject.Geometry;
      Brep aBrep = Brep.TryConvertBrep(Geometry);                   //Brep으로 바꿔줘야 한다
      breps.Add(aBrep);
    }

    //Srf check
    foreach(var item in C)
    {
      Point3d pOrigin = item.PointAt(0, 0);
      double sOriginZ = pOrigin.Z;
      unsortedOriginZ.Add(sOriginZ);
      sortedOriginZ.Add(sOriginZ);
    }

    sortedOriginZ.Sort();
    if(sortedOriginZ[0] > sortedOriginZ[sortedOriginZ.Count - 1])
    {
      sortedOriginZ.Reverse();
    }
    for(int i = 0; i < sortedOriginZ.Count; i++)
    {
      int idx = unsortedOriginZ.IndexOf(sortedOriginZ[i]);
      sortedSrfs.Add(C[idx]);
    }
    Surface dupSrf = (Surface) sortedSrfs[0].Duplicate();
    sortedSrfs.Insert(0, dupSrf);

    //Srf to Brep
    for(int i = 0; i < sortedSrfs.Count; i++)
    {
      Brep convertedCutter = sortedSrfs[i].ToBrep();
      Vector3d testNorm = sortedSrfs[i].NormalAt(0, 0);
      if(i == 0)
      {
        if(testNorm.Z > 0)
        {
          convertedCutter.Flip();
        }
      }
      else
      {
        if(testNorm.Z < 0)
        {
          convertedCutter.Flip();
        }
      }
      cutterBreps.Add(convertedCutter);
    }
    
    //BrepSplit and Cap
    foreach(var aBrep in breps)
    {
      Brep[] splitted = aBrep.Split(cutterBreps, RhinoDocument.ModelAbsoluteTolerance);
      foreach(Brep item in splitted)
      {
        Brep Capped = item.CapPlanarHoles(RhinoDocument.ModelAbsoluteTolerance);
        diffed.Add(Capped);
      }
    }
    A = diffed;
    Cutters = cutterBreps;
# ---------- end c_script ----------
c_script_2 = CSharpScript()  # -> A, Cutters, TreeTest; inputs B: list of Guid, C: list of Surface
# ---------- c_script_2: C# ----------
    List<Brep> breps = new List<Brep>();
    List<Brep> cutterBreps = new List<Brep>();
    List<Surface> sortedSrfs = new List<Surface>();
    List <double> unsortedOriginZ = new List<double>();
    List <double> sortedOriginZ = new List<double>();
    List<BoundingBox> boundings = new List<BoundingBox>();
    List<Brep> diffed = new List<Brep>();

    //DataTrees
    Grasshopper.DataTree<object> tree = new Grasshopper.DataTree<object>();
    List<GH_Path> subtrees = new List<GH_Path>();
    for (int i = 0; i < B.Count; i++)
    {
      GH_Path newPath = new GH_Path(i);
      subtrees.Add(newPath);
    }

    //Guid to Brep
    for(int i = 0; i < B.Count; i++)
    {
      var RhinoObject = RhinoDocument.Objects.Find(B[i]);
      var Geometry = RhinoObject.Geometry;
      Brep aBrep = Brep.TryConvertBrep(Geometry);                   //Brep으로 바꿔줘야 한다
      breps.Add(aBrep);
    }

    //Srf check
    foreach(var item in C)
    {
      Point3d pOrigin = item.PointAt(0, 0);
      double sOriginZ = pOrigin.Z;
      unsortedOriginZ.Add(sOriginZ);
      sortedOriginZ.Add(sOriginZ);
    }

    sortedOriginZ.Sort();
    if(sortedOriginZ[0] > sortedOriginZ[sortedOriginZ.Count - 1])
    {
      sortedOriginZ.Reverse();
    }
    for(int i = 0; i < sortedOriginZ.Count; i++)
    {
      int idx = unsortedOriginZ.IndexOf(sortedOriginZ[i]);
      sortedSrfs.Add(C[idx]);
    }

    //Srf to Brep
    for(int i = 0; i < sortedSrfs.Count; i++)
    {
      Brep convertedCutter = sortedSrfs[i].ToBrep();
      Vector3d testNorm = sortedSrfs[i].NormalAt(0, 0);
      if(i == 0)
      {
        if(testNorm.Z > 0)
        {
          convertedCutter.Flip();
        }
      }
      else
      {
        if(testNorm.Z < 0)
        {
          convertedCutter.Flip();
        }
      }
      cutterBreps.Add(convertedCutter);
    }

    //BrepSplit and Cap
    List<Brep> newCap = new List<Brep>();
    for(int i = 0; i < breps.Count; i++)
    {
      newCap.Clear();
      Brep[] splitted = breps[i].Split(cutterBreps, RhinoDocument.ModelAbsoluteTolerance);
      for(int j = 0; j < splitted.Length; j++)
      {
        Brep Capped = splitted[j].CapPlanarHoles(RhinoDocument.ModelAbsoluteTolerance);
        newCap.Add(Capped);
        diffed.Add(Capped);
      }
      tree.AddRange(newCap, subtrees[i]);
    }
    A = diffed;
    Cutters = cutterBreps;
    TreeTest = tree;
# ---------- end c_script_2 ----------

# ----
c_script_3 = CSharpScript(B=solids, C=srf4pt, FL=item)  # -> Vols; inputs B: list of Guid, C: list of Surface, FL: list
# ---------- c_script_3: C# ----------
    List<Brep> breps = new List<Brep>();
    List<Brep> cutterBreps = new List<Brep>();
    List<Surface> sortedSrfs = new List<Surface>();
    List<double> unsortedOriginZ = new List<double>();
    List<double> sortedOriginZ = new List<double>();
    List<string> fLevels = new List<string>();
    List<Brep> newCappeds = new List<Brep>();
    Plane xyPlane = new Plane(0, 0, 1, 0);
    List<Interval> flRanges = new List<Interval>();
    List<double> BrepRange = new List<double>();
    List<int> containments = new List<int>();

    //DataTrees
    Grasshopper.DataTree<object> tree1 = new Grasshopper.DataTree<object>();
    Grasshopper.DataTree<double> tree2 = new Grasshopper.DataTree<double>();
    Grasshopper.DataTree<string> tree3 = new Grasshopper.DataTree<string>();
    //subtrees1
    List<GH_Path> subtrees1 = new List<GH_Path>();
    for (int i = 0; i < B.Count + 1; i++)
    {
      GH_Path newPath = new GH_Path(i);
      subtrees1.Add(newPath);
    }
    //subtrees2
    List<GH_Path> subtrees2 = new List<GH_Path>();
    for (int i = 0; i < B.Count + 1; i++)
    {
      GH_Path newPath = new GH_Path(i);
      subtrees2.Add(newPath);
    }
    //subtrees3
    List<GH_Path> subtrees3 = new List<GH_Path>();
    for (int i = 0; i < B.Count + 1; i++)
    {
      GH_Path newPath = new GH_Path(i);
      subtrees3.Add(newPath);
    }

    //Guid to Brep
    for(int i = 0; i < B.Count; i++)
    {
      var RhinoObject = RhinoDocument.Objects.Find(B[i]);
      var Geometry = RhinoObject.Geometry;
      Brep aBrep = Brep.TryConvertBrep(Geometry);                   //Brep으로 바꿔줘야 한다
      breps.Add(aBrep);
    }

    //Get Integrated brep of All input Brep
    Brep integrated = new Brep();
    for(int i = 0; i < breps.Count; i++)
    {
      integrated.Append(breps[i]);
    }

    //Get Z Axis Range of all Breps
    BoundingBox integratedBbox = integrated.GetBoundingBox(xyPlane);
    BrepRange.Add(integratedBbox.Min.Z);
    BrepRange.Add(integratedBbox.Max.Z);

    //Srf check and sort Srf, fLevels
    foreach(var item in C)
    {
      Point3d pOrigin = item.PointAt(0, 0);
      double sOriginZ = pOrigin.Z;
      unsortedOriginZ.Add(sOriginZ);
      sortedOriginZ.Add(sOriginZ);
    }

    sortedOriginZ.Sort();
    if(sortedOriginZ[0] > sortedOriginZ[sortedOriginZ.Count - 1])
    {
      sortedOriginZ.Reverse();
    }
    for(int i = 0; i < sortedOriginZ.Count; i++)
    {
      int idx = unsortedOriginZ.IndexOf(sortedOriginZ[i]);
      sortedSrfs.Add(C[idx]);
      fLevels.Add(FL[idx].ToString());
      BrepRange.Insert(i + 1, sortedOriginZ[i]);
    }
    fLevels.Insert(0, "BOTTOM");

    //Make Intervals
    for(int i = 0;i < BrepRange.Count - 1;i++)
    {
      Interval flRange = new Interval(BrepRange[i], BrepRange[i + 1]);
      flRanges.Add(flRange);
    }


    //Srf to Brep
    for(int i = 0; i < sortedSrfs.Count; i++)
    {
      Brep convertedCutter = sortedSrfs[i].ToBrep();
      Vector3d testNorm = sortedSrfs[i].NormalAt(0, 0);
      if(i == 0)
      {
        if(testNorm.Z > 0)
        {
          convertedCutter.Flip();
        }
      }
      else
      {
        if(testNorm.Z < 0)
        {
          convertedCutter.Flip();
        }
      }
      cutterBreps.Add(convertedCutter);
    }


    //BrepSplit, Cap and Sort into Array
    List<Brep> newCap = new List<Brep>();
    List<Brep> addToBreps = new List<Brep>();
    List<double> addToVols = new List<double>();
    List<string> addToVolsStr = new List<string>();
    for(int i = 0; i < breps.Count; i++)
    {
      addToBreps.Clear();
      addToVols.Clear();
      addToVolsStr.Clear();
      newCap.Clear();
      Brep[] splitted = breps[i].Split(cutterBreps, RhinoDocument.ModelAbsoluteTolerance);
      for(int j = 0; j < splitted.Length; j++)
      {
        Brep Capped = splitted[j].CapPlanarHoles(RhinoDocument.ModelAbsoluteTolerance);
        newCap.Add(Capped);
      }
      List<int> b = brepIndexer(flRanges, newCap);

      addToBreps = ListFiller(newCap, b, flRanges.Count);
      addToVols = BrepVolChanger(addToBreps);
      addToVolsStr = BrepVolChangerStr(addToBreps);

      //Layer name extract
      var obj = RhinoDocument.Objects.Find(B[i]);
      string brepLayerName = RhinoDocument.Layers[obj.Attributes.LayerIndex].ToString();
      addToVolsStr.Insert(0, brepLayerName);
      tree1.AddRange(addToBreps, subtrees1[i]);
      tree2.AddRange(addToVols, subtrees2[i]);
      tree3.AddRange(addToVolsStr, subtrees3[i + 1]);
    }
    fLevels.Insert(0, "층 및 암종류");
    tree3.AddRange(fLevels, subtrees3[0]);
    Vols = tree3;
# ---------- c_script_3: C# additional code ----------
  public double brepCenZ(Brep item)
  {
    Plane newPlane = new Plane(0, 0, 1, 0);
    BoundingBox newBox = item.GetBoundingBox(newPlane);
    Point3d bboxCen = (newBox.Min + newBox.Max) / 2;
    double zValue = bboxCen.Z;
    return zValue;
  }

  public List<int> brepIndexer(List<Interval> intervals, List<Brep> Breps)
  {
    List<int> IdxBox = new List<int>();
    int idx = -1;
    for(int i = 0; i < Breps.Count; i++)
    {
      double a = brepCenZ(Breps[i]);
      for(int j = 0; j < intervals.Count; j++)
      {
        if(intervals[j].IncludesParameter(a))
        {
          idx = j;
          IdxBox.Add(j);
        }
      }
    }
    return IdxBox;
  }

  public List<Brep> ListFiller (List<Brep> Breps, List<int> Indexes, int k)
  {
    List<Brep> newList = new List<Brep>();
    for(int i = 0; i < k; i++)
    {
      newList.Add(null);
    }
    for(int i = 0; i < Breps.Count; i++)
    {
      newList[Indexes[i]] = Breps[i];
    }
    return newList;
  }
  public List<double> BrepVolChanger(List<Brep> FilledList)
  {
    double vol = 0;
    List<double> Vols = new List<double>();
    foreach(var item in FilledList)
    {
      if(item != null)
      {
        vol = item.GetVolume();
      }
      else
      {
        vol = 0;
      }
      Vols.Add(vol);
    }
    return Vols;
  }

  public List<string> BrepVolChangerStr(List<Brep> FilledList)
  {
    double vol = 0;
    List<string> Vols = new List<string>();
    foreach(var item in FilledList)
    {
      if(item != null)
      {
        vol = item.GetVolume();
      }
      else
      {
        vol = 0;
      }
      Vols.Add(vol.ToString("F2"));
    }
    return Vols;
  }
# ---------- end c_script_3 ----------
flip_2 = FlipMatrix(Data=c_script_3)
item_9 = ListItem(List=flip_2, Index="0", Wrap=True)  # -> flatten(Item)
cull_i = CullIndex(List=flip_2, Indices="0", Wrap=True)
csv_2 = CreateCSV(DataGridHeaders=item_9, ValueTree=cull_i, Delimiter=",")
# 230109
# 스터디 내용 정리
# 
# Grasshopper에서 Geometry가 로드되는 방법은 2가지임
# 
# 1. 각종 컴포넌트를 통해 생성된 것
# 2. 파라미터를 통해 ref 된것
# 
# 여기서 2의 경우는 이미 생성된 것이니 guid를 가지고 있지만,
# 1의 경우는 아직 bake 실행 전(즉, 오브젝트 생성 전) 이므로 guid가 없다.
# 
# 따라서 split이후 분류를 할때 geometry 에서의 분류는 geometry 자체의 특성 (높이값, 좌표 등)을 통해 분류해야 하며, GUID를 통해 layer 이름등을 얻는 행위는 2의 경우만 가능하다
# 
# 본 스크립트에서는 아래와 같이 분류하기로 한다.
# 
# 1. split의 cutter로 쓸 서피스를 미리 딕셔너리 등으로 분류 (ex. 1번 cutter 등)
# 2. 이때, 솔리드 타입의 인덱스(레이어) 기준으로 for문 실행
# 3. for문 속의 for문을 이용해 몇번 cutter로 split 했는지 구분.
# 4. 이러면 토사솔리드 종류, cutter 종류 라는 2가지 변수를 통해 테이블화 가능
panel = Panel(csv_2)
